# Dynamo graph setElementsPinStatus.dyn (Dynamo 2.5.0.5905)

select_model_elements = DSModelElementsSelection()  # 1 picked in the model
boolean = BoolSelector(true)
setPinnedStatus = Element.SetPinnedStatus(element=select_model_elements, pinned=boolean)
